# Grasshopper definition Ripples_SineWave.gh (Grasshopper 1.0.7)
# plug-ins: V-Ray For Grasshopper 6

number_slider = Slider(200, range=0..1000)
cir = Circle(Plane=PlaneXY(0, 0, 0), Radius=Slider(2, range=0..100))
cir_2 = Circle(Plane=PlaneXY(0, 0, 0), Radius=Slider(25, range=0..100))  # -> simplify(Circle)
pi = Pi(Factor=Slider(10, range=0..10))
range = Range(Domain=Domain(0, 1), Steps=Slider(231, range=0..1000))
dom = ConstructDomain(DomainStart=0, DomainEnd=pi)
range_2 = Range(Domain=Domain(0, 1), Steps=Slider(54, range=0..100))
remap = RemapNumbers(Value=range, Source=Domain(0, 1), Target=dom)  # -> Mapped, Clipped
timeline = VRayTimeline(FramesCount=number_slider, RangeStart=Slider(14, range=0..100), RangeEnd=Slider(199, range=0..1000))  # -> Timeline, CurrentFrame, CurrentFraction
cull_i = CullIndex(List=range_2, Indices="0", Wrap=True)
number_slider_2 = Slider(1.555, range=0..10)
subtraction = Subtraction(A=number_slider, B="1")
eval = EvaluateCurve(Curve=reparameterize(cir_2), Parameter=cull_i)  # -> Point, Tangent, Angle
eval_2 = EvaluateCurve(Curve=reparameterize(cir), Parameter=cull_i)  # -> Point, Tangent, Angle
graph = GraphMapper(
    range,
    x0=0,
    x1=1,
    y0=0,
    y1=1,
    container_name="Bezier",
    cpx=[0, 0.4877851605, 0.8460496664, 1],
    cpy=[0, 0.04546320438, 0.2842026949, 1])
pi_2 = Pi(Factor=Slider(2, range=0..10))
graph_2 = GraphMapper(
    range,
    x0=0,
    x1=1,
    y0=0,
    y1=1,
    container_name="Bezier",
    cpx=[0, 0.4685659409, 0.5745326877, 1],
    cpy=[0, 0.393058002, 0.2217521071, 0])
dom_2 = ConstructDomain(DomainStart=0, DomainEnd=subtraction)
ln = Line(StartPoint=eval.Point, EndPoint=eval_2.Point)
multiplication = Multiplication(A=number_slider_2, B=Slider(0, range=0..10))
dom_3 = ConstructDomain(DomainStart=0, DomainEnd=pi_2)
dispatch = Dispatch(List=ln, DispatchPattern=[True, False])  # -> ListA, ListB
number_slider_3 = Slider(4, range=0..100)
eval_3 = EvaluateCurve(Curve=reparameterize(graft(dispatch.ListA)), Parameter=range)  # -> Point, Tangent, Angle
remap_2 = RemapNumbers(Value=timeline.CurrentFrame, Source=dom_2, Target=dom_3)  # -> Mapped, Clipped
addition = Addition(A=remap.Mapped, B=remap_2.Mapped)
sin = Sine(Value=addition)
multiplication_2 = Multiplication(A=sin, B=number_slider_2)
neg = Negative(Value=multiplication_2)
addition_2 = Addition(A=neg, B=multiplication)
eval_4 = EvaluateCurve(Curve=reparameterize(graft(dispatch.ListB)), Parameter=range)  # -> Point, Tangent, Angle
Z = UnitZ(Factor=1)
Z_2 = UnitZ(Factor=1)
multiplication_3 = Multiplication(A=graph_2, B=addition_2)
xprod = CrossProduct(VectorA=eval_3.Tangent, VectorB=Z, Unitize=False)  # -> simplify(Vector), Length
xprod_2 = CrossProduct(VectorA=eval_4.Tangent, VectorB=Z_2, Unitize=False)  # -> simplify(Vector), Length
multiplication_4 = Multiplication(A=graph, B=Slider(3.5, range=0..10))
Z_3 = UnitZ(Factor=multiplication_4)
amp = Amplitude(Vector=xprod.Vector, Amplitude=multiplication_3)  # -> simplify(Vector)
neg_2 = Negative(Value=multiplication_3)
amp_2 = Amplitude(Vector=xprod_2.Vector, Amplitude=neg_2)  # -> simplify(Vector)
addition_3 = Addition(A=amp, B=Z_3)
addition_4 = Addition(A=amp_2, B=Z_3)
move = Move(Geometry=eval_3.Point, Motion=addition_3)  # -> Geometry, Transform
move_2 = Move(Geometry=eval_4.Point, Motion=addition_4)  # -> Geometry, Transform
number_slider_4 = Slider(0, range=0..10)
nurbs = NurbsCurve(Vertices=move.Geometry, Degree=3, Periodic=False)  # -> flatten(Curve), Length, Domain
nurbs_2 = NurbsCurve(Vertices=move_2.Geometry, Degree=3, Periodic=False)  # -> flatten(Curve), Length, Domain
neg_3 = Negative(Value=Slider(1, range=0..1))
tweencrv = TweenCurve(CurveA=nurbs_2.Curve, CurveB=nurbs.Curve, Factor=0.5, BlendType=0)
xy = XYPlane(Origin=Point(0, 0, 0))
shift = ShiftList(List=nurbs.Curve, Shift=neg_3, Wrap=True)
tweencrv_2 = TweenCurve(CurveA=nurbs_2.Curve, CurveB=shift, Factor=0.5, BlendType=0)
item = ListItem(List=tweencrv_2, Index=number_slider_4, Wrap=True)
item_2 = ListItem(List=nurbs_2.Curve, Index=number_slider_4, Wrap=True)
project = Project(Geometry=tweencrv, Plane=xy)  # -> Geometry, Transform
project_2 = Project(Geometry=tweencrv_2, Plane=xy)  # -> Geometry, Transform
panel = Panel("""0
1
2
3""")
weave = Weave(
    Pattern=panel,
    Stream0=project_2.Geometry,
    Stream1=nurbs.Curve,
    Stream2=project.Geometry,
    Stream3=nurbs_2.Curve,
    NullGaps=False)
loft_opt = LoftOptions(Closed=Toggle(True), Adjust=False, Rebuild=0, Refit=0, Type=0)
loft = Loft(Curves=weave, Options=loft_opt)
mtl_simple = VRayMaterialSimple(Diffuse=RGB(137, 137, 137), Reflection=RGB(137, 137, 137), Glossiness=0.85, IOR=1.3, Opacity=1, Emission=RGB(0, 0, 0))
pt = ConstructPoint(XCoordinate=0, YCoordinate=0, ZCoordinate=Slider(0, range=0..100))
pt_2 = ConstructPoint(XCoordinate=0, YCoordinate=0, ZCoordinate=Slider(190, range=0..1000))
sampler = Sampler(1, Has_Extract_Parameter=False, Has_Manage_Collection=False, OptionsLength=2, Options=["Progressive", "Bucket"])
save_file = OutputImage(
    "D:\Rhino_Grass\SinWave\a.jpg",
    File_Picker=1,
    File_Types="Portable Network Graphics (*.png)|*.png|Windows bitmap (*.bmp)|*.bmp|Targa Image (*.tga)|*.tga|Radiance High-Dynamyc Range (*.hdr)|*.hdr|Silicon Graphics (*.sgi; *.rgb; *.rgba)|*.dgi;*.rgb;*.rgba|JPEG image (*.jpg; *.jpeg)|*.jpg;*.jpeg|OpenEXR image (*.exr)|*.exr|SoftImage PICT (*.pic)|*.pic|Tagged image (*.tif; *.tiff)|*.tif;*.tiff|V-Ray Raw Image (*.vrimg)|*.vrimg",
    Has_Extract_Parameter=False,
    Has_Manage_Collection=True,
    Has_Multiple_Files_Menu=False,
    Has_Picker_File_Menu=False,
    Multiple_Files=False)
engine = Engine(1, Has_Extract_Parameter=False, Has_Manage_Collection=False, OptionsLength=2, Options=["CPU", "GPU"])
mode = Mode(1, Has_Extract_Parameter=False, Has_Manage_Collection=False, OptionsLength=2, Options=["Interactive", "Production"])
quality = Quality(
    3,
    Has_Extract_Parameter=False,
    Has_Manage_Collection=False,
    OptionsLength=5,
    Options=["Draft", "Low", "Medium", "High", "Very High"])
vgeo = VRayGeometry(Geo=loft, Material=mtl_simple)
rig_dome = VRayLightRigDome(
    LightOn=True,
    Visible=Toggle(False),
    Texture="D:\Rhino_Grass\Minitunnel\the_lost_city_4k.hdr",
    Intensity=Slider(1, range=0..10),
    Rotation=Slider(4, range=0..360),
    BackgroundIntensity=1)
camera = VRayCamera(
    Position=pt_2,
    Target=pt,
    FOV=Slider(18, range=0..1000),
    PhysicalExposureOn=False,
    FNumber=8,
    ShutterSpeed1S=100,
    FilmSensitivity=Slider(453, range=0..1000))  # -> Camera, Angle
render = VRayRender(
    Engine=engine,
    Mode=mode,
    Sampler=sampler,
    Quality=quality,
    OutputImage=save_file,
    OutputResolution=[1000, 1000],
    Camera=camera.Camera,
    LightRig=rig_dome,
    VGeometry=flatten(vgeo),
    Timeline=timeline.Timeline)
